# Grasshopper definition 150620 jigsaw puzzle generator.gh (Grasshopper 0.9.76)
# plug-ins: LunchBox

bakebutton = Button()
number_slider = Slider(0, range=0..10)
number_slider_2 = Slider(0, range=0..10)
swatch = ColourSwatch(SwatchColor=RGB(255, 0, 0))

amount_of_tiles_in_y_direction = Slider(20, range=0..100)
amount_of_tiles_in_x_direction = Slider(25, range=0..100)
list = ValueList({"Jigsaw pieces": True, "Curves": False}, selected="Jigsaw pieces")
size_tiles = Panel("2")

sqgrid = Square(Plane=PlaneXY(0, 0, 0), Size=size_tiles, ExtentX=amount_of_tiles_in_x_direction, ExtentY=amount_of_tiles_in_y_direction)  # -> Cells, Points

lng = ListLength(List=flatten(sqgrid.Cells))
number_of_puzzle_pieces = Panel(lng)

shift = ShiftList(List=sqgrid.Points, Shift=1, Wrap=False)
shift_2 = ShiftList(List=sqgrid.Points, Shift=-1, Wrap=False)
flip = FlipMatrix(Data=sqgrid.Points)
flip_2 = FlipMatrix(Data=sqgrid.Points)
ln = Line(StartPoint=shift, EndPoint=shift_2)
shift_3 = ShiftList(List=flip, Shift=1, Wrap=False)
shift_4 = ShiftList(List=flip_2, Shift=-1, Wrap=False)
flip_3 = FlipMatrix(Data=ln)
ln_2 = Line(StartPoint=shift_3, EndPoint=shift_4)
flip_4 = FlipMatrix(Data=ln_2)

# ---- group: x-direction
subtraction = Subtraction(A=amount_of_tiles_in_y_direction, B="1")
subtraction_2 = Subtraction(A=subtraction, B="1")
dom = ConstructDomain(DomainStart="1", DomainEnd=subtraction)
range = Range(Domain=dom, Steps=subtraction_2)
int = Integer(range)
item = ListItem(List=simplify(flip_4), Index=int, Wrap=True)
curvepoint = PointOnCurve(item, parameter=0.5)
pt = Point(curvepoint)
flatten = FlattenTree(Tree=pt, Path="{0}")
factor = Slider(21, range=0..60)
factor_2 = Slider(17, range=0..60)
lng_2 = ListLength(List=flatten(flatten))
division = Division(A="1", B="3")
division_2 = Division(A=size_tiles, B=factor_2)
division_3 = Division(A="2", B="3")
division_4 = Division(A=size_tiles, B=factor)
random = Random(Range=Domain(0, 1), Number=lng_2, Seed=2)
subtraction_3 = Subtraction(A=division, B=division_2)
addition = Addition(A=division, B=division_2)
subtraction_4 = Subtraction(A=division_3, B=division_4)
addition_2 = Addition(A=division_3, B=division_4)
int_2 = Integer(random)
bool = Boolean(int_2)
lng_3 = ListLength(List=flatten(item))
lng_4 = ListLength(List=flatten(item))
dom_2 = ConstructDomain(DomainStart=subtraction_4, DomainEnd=addition_2)
dom_3 = ConstructDomain(DomainStart=subtraction_3, DomainEnd=addition)
end = EndPoints(Curve=item)  # -> Start, End
graft = GraftTree(Tree=flatten, IncludeEmptyLists=True, IncludeNullItems=True)  # -> simplify(Tree)
graft_2 = GraftTree(Tree=bool, IncludeEmptyLists=True, IncludeNullItems=True)  # -> simplify(Tree)
random_2 = Random(Range=dom_3, Number=lng_3, Seed=2)
random_3 = Random(Range=dom_2, Number=lng_4, Seed=5)
div_list = DivideListIntoGroups(data=random_2, number=subtraction)
div_list_2 = DivideListIntoGroups(data=random_3, number=subtraction)
cull = CullPattern(List=graft, CullPattern=invert(graft_2))
cull_2 = CullPattern(List=graft, CullPattern=graft_2)
division_5 = Division(A=size_tiles, B="5")
eval = EvaluateCurve(Curve=simplify(item), Parameter=simplify(div_list))  # -> Point, Tangent, Angle
eval_2 = EvaluateCurve(Curve=simplify(item), Parameter=simplify(div_list_2))  # -> Point, Tangent, Angle
neg = Negative(Value=division_5)
prune = PruneTree(Tree=cull_2, Minimum="1", Maximum=0)
prune_2 = PruneTree(Tree=cull, Minimum="1", Maximum=0)
Y = UnitY(Factor=neg)
Y_2 = UnitY(Factor=division_5)
move = Move(Geometry=prune, Motion=Y)  # -> Geometry, Transform
move_2 = Move(Geometry=prune_2, Motion=Y_2)  # -> Geometry, Transform
merge = Merge(Data1=move.Geometry, Data2=move_2.Geometry)
factor_3 = Slider(20, range=0..20)
division_6 = Division(A=size_tiles, B=factor_3)
neg_2 = Negative(Value=division_6)
lng_5 = ListLength(List=flatten(merge))
factor_4 = Slider(5, range=0..20)
dom_4 = ConstructDomain(DomainStart=neg_2, DomainEnd=division_6)
random_4 = Random(Range=dom_4, Number=lng_5, Seed=2)
Y_3 = UnitY(Factor=random_4)
division_7 = Division(A=size_tiles, B=factor_4)
move_3 = Move(Geometry=flatten(merge), Motion=Y_3)  # -> Geometry, Transform
X = UnitX(Factor=division_7)
neg_3 = Negative(Value=X)
move_4 = Move(Geometry=move_3.Geometry, Motion=X)  # -> Geometry, Transform
move_5 = Move(Geometry=move_3.Geometry, Motion=neg_3)  # -> Geometry, Transform
factor_5 = Slider(16, range=0..30)
factor_6 = Slider(28, range=0..30)
division_8 = Division(A=size_tiles, B=factor_6)
division_9 = Division(A=size_tiles, B=factor_5)
neg_4 = Negative(Value=division_8)
neg_5 = Negative(Value=division_9)
lng_6 = ListLength(List=flatten(move_4.Geometry))
lng_7 = ListLength(List=flatten(move_4.Geometry))
dom_5 = ConstructDomain(DomainStart=neg_4, DomainEnd=division_8)
dom_6 = ConstructDomain(DomainStart=neg_5, DomainEnd=division_9)
random_5 = Random(Range=dom_5, Number=lng_6, Seed=2)
random_6 = Random(Range=dom_6, Number=lng_7, Seed=3)
X_2 = UnitX(Factor=random_5)
X_3 = UnitX(Factor=random_6)
move_6 = Move(Geometry=move_4.Geometry, Motion=X_2)  # -> Geometry, Transform
move_7 = Move(Geometry=move_5.Geometry, Motion=X_3)  # -> Geometry, Transform
graft_3 = GraftTree(Tree=move_6.Geometry, IncludeEmptyLists=True, IncludeNullItems=True)  # -> simplify(Tree)
graft_4 = GraftTree(Tree=move_7.Geometry, IncludeEmptyLists=True, IncludeNullItems=True)  # -> simplify(Tree)
div_list_3 = DivideListIntoGroups(data=graft_3, number=subtraction)
div_list_4 = DivideListIntoGroups(data=graft_4, number=subtraction)
pt_2 = Point(simplify(end.Start))
pt_3 = Point(simplify(eval.Point))
pt_4 = Point(simplify(div_list_3))
pt_5 = Point(simplify(div_list_4))
pt_6 = Point(simplify(eval_2.Point))
pt_7 = Point(simplify(end.End))
graft_5 = GraftTree(Tree=pt_2, IncludeEmptyLists=True, IncludeNullItems=True)
graft_6 = GraftTree(Tree=pt_3, IncludeEmptyLists=True, IncludeNullItems=True)
graft_7 = GraftTree(Tree=pt_4, IncludeEmptyLists=True, IncludeNullItems=True)
graft_8 = GraftTree(Tree=pt_5, IncludeEmptyLists=True, IncludeNullItems=True)
graft_9 = GraftTree(Tree=pt_6, IncludeEmptyLists=True, IncludeNullItems=True)
graft_10 = GraftTree(Tree=pt_7, IncludeEmptyLists=True, IncludeNullItems=True)
merge_2 = Merge(Data1=graft_5, Data2=graft_6, Data3=graft_7, Data4=graft_8, Data5=graft_9, Data6=graft_10)
intcrv = Interpolate(Vertices=merge_2, Degree=3, Periodic=False, KnotStyle=1)  # -> Curve, Length, Domain
flatten_2 = FlattenTree(Tree=intcrv.Curve, Path="{0}")
div_list_5 = DivideListIntoGroups(data=flatten_2, number=subtraction)

# ---- group: y-direction
subtraction_5 = Subtraction(A=amount_of_tiles_in_x_direction, B="1")
subtraction_6 = Subtraction(A=subtraction_5, B="1")
dom_7 = ConstructDomain(DomainStart="1", DomainEnd=subtraction_5)
range_2 = Range(Domain=dom_7, Steps=subtraction_6)
int_3 = Integer(range_2)
item_2 = ListItem(List=flip_3, Index=int_3, Wrap=True)
curvepoint_2 = PointOnCurve(item_2, parameter=0.5)
pt_8 = Point(curvepoint_2)
flatten_3 = FlattenTree(Tree=pt_8, Path="{0}")
lng_8 = ListLength(List=flatten(flatten_3))
random_7 = Random(Range=Domain(0, 1), Number=lng_8, Seed=2)
factor_7 = Slider(18, range=0..60)
factor_8 = Slider(20, range=0..60)
int_4 = Integer(random_7)
number_slider_3 = Slider(0.059, range=0..0.1)
bool_2 = Boolean(int_4)
division_10 = Division(A=size_tiles, B=factor_7)
graft_11 = GraftTree(Tree=flatten_3, IncludeEmptyLists=True, IncludeNullItems=True)  # -> simplify(Tree)
graft_12 = GraftTree(Tree=bool_2, IncludeEmptyLists=True, IncludeNullItems=True)  # -> simplify(Tree)
division_11 = Division(A="1", B="3")
division_12 = Division(A="2", B="3")
division_13 = Division(A=size_tiles, B=factor_8)
end_2 = EndPoints(Curve=item_2)  # -> Start, End
subtraction_7 = Subtraction(A=division_11, B=division_10)
addition_3 = Addition(A=division_11, B=division_10)
subtraction_8 = Subtraction(A=division_12, B=division_13)
addition_4 = Addition(A=division_12, B=division_13)
cull_3 = CullPattern(List=graft_11, CullPattern=invert(graft_12))
division_14 = Division(A=size_tiles, B="5")
cull_4 = CullPattern(List=graft_11, CullPattern=graft_12)
neg_6 = Negative(Value=division_14)
lng_9 = ListLength(List=flatten(item_2))
lng_10 = ListLength(List=flatten(item_2))
dom_8 = ConstructDomain(DomainStart=subtraction_7, DomainEnd=addition_3)
dom_9 = ConstructDomain(DomainStart=subtraction_8, DomainEnd=addition_4)
prune_3 = PruneTree(Tree=cull_3, Minimum="1", Maximum=0)
prune_4 = PruneTree(Tree=cull_4, Minimum="1", Maximum=0)
X_4 = UnitX(Factor=neg_6)
X_5 = UnitX(Factor=division_14)
random_8 = Random(Range=dom_8, Number=lng_9, Seed=6)
random_9 = Random(Range=dom_9, Number=lng_10, Seed=9)
move_8 = Move(Geometry=prune_4, Motion=X_4)  # -> Geometry, Transform
move_9 = Move(Geometry=prune_3, Motion=X_5)  # -> Geometry, Transform
div_list_6 = DivideListIntoGroups(data=random_8, number=subtraction_5)
div_list_7 = DivideListIntoGroups(data=random_9, number=subtraction_5)
eval_3 = EvaluateCurve(Curve=simplify(item_2), Parameter=simplify(div_list_6))  # -> Point, Tangent, Angle
eval_4 = EvaluateCurve(Curve=simplify(item_2), Parameter=simplify(div_list_7))  # -> Point, Tangent, Angle
merge_3 = Merge(Data1=move_8.Geometry, Data2=move_9.Geometry)
factor_9 = Slider(9, range=0..10)
division_15 = Division(A=size_tiles, B=factor_9)
neg_7 = Negative(Value=division_15)
lng_11 = ListLength(List=flatten(merge_3))
dom_10 = ConstructDomain(DomainStart=neg_7, DomainEnd=division_15)
random_10 = Random(Range=dom_10, Number=lng_11, Seed=2)
X_6 = UnitX(Factor=random_10)
move_10 = Move(Geometry=flatten(merge_3), Motion=X_6)  # -> Geometry, Transform
Y_4 = UnitY(Factor=division_7)
move_11 = Move(Geometry=move_10.Geometry, Motion=Y_4)  # -> Geometry, Transform
neg_8 = Negative(Value=Y_4)
move_12 = Move(Geometry=move_10.Geometry, Motion=neg_8)  # -> Geometry, Transform
factor_10 = Slider(28, range=0..30)
factor_11 = Slider(58, range=0..60)
division_16 = Division(A=size_tiles, B=factor_10)
division_17 = Division(A=size_tiles, B=factor_11)
neg_9 = Negative(Value=division_16)
neg_10 = Negative(Value=division_17)
lng_12 = ListLength(List=flatten(move_11.Geometry))
lng_13 = ListLength(List=flatten(move_12.Geometry))
dom_11 = ConstructDomain(DomainStart=neg_9, DomainEnd=division_16)
dom_12 = ConstructDomain(DomainStart=neg_10, DomainEnd=division_17)
random_11 = Random(Range=dom_11, Number=lng_12, Seed=2)
random_12 = Random(Range=dom_12, Number=lng_13, Seed=3)
Y_5 = UnitY(Factor=random_11)
Y_6 = UnitY(Factor=random_12)
move_13 = Move(Geometry=move_11.Geometry, Motion=Y_5)  # -> Geometry, Transform
move_14 = Move(Geometry=move_12.Geometry, Motion=Y_6)  # -> Geometry, Transform
graft_13 = GraftTree(Tree=move_13.Geometry, IncludeEmptyLists=True, IncludeNullItems=True)  # -> simplify(Tree)
graft_14 = GraftTree(Tree=move_14.Geometry, IncludeEmptyLists=True, IncludeNullItems=True)  # -> simplify(Tree)
div_list_8 = DivideListIntoGroups(data=graft_13, number=subtraction_5)
div_list_9 = DivideListIntoGroups(data=graft_14, number=subtraction_5)
pt_9 = Point(simplify(end_2.Start))
pt_10 = Point(simplify(eval_3.Point))
pt_11 = Point(simplify(div_list_8))
pt_12 = Point(simplify(div_list_9))
pt_13 = Point(simplify(eval_4.Point))
pt_14 = Point(simplify(end_2.End))
graft_15 = GraftTree(Tree=pt_9, IncludeEmptyLists=True, IncludeNullItems=True)
graft_16 = GraftTree(Tree=pt_10, IncludeEmptyLists=True, IncludeNullItems=True)
graft_17 = GraftTree(Tree=pt_11, IncludeEmptyLists=True, IncludeNullItems=True)
graft_18 = GraftTree(Tree=pt_12, IncludeEmptyLists=True, IncludeNullItems=True)
graft_19 = GraftTree(Tree=pt_13, IncludeEmptyLists=True, IncludeNullItems=True)
graft_20 = GraftTree(Tree=pt_14, IncludeEmptyLists=True, IncludeNullItems=True)
merge_4 = Merge(Data1=graft_15, Data2=graft_16, Data3=graft_17, Data4=graft_18, Data6=graft_19, Data7=graft_20)
intcrv_2 = Interpolate(Vertices=merge_4, Degree=3, Periodic=False, KnotStyle=1)  # -> Curve, Length, Domain
flatten_4 = FlattenTree(Tree=intcrv_2.Curve, Path="{0}")
div_list_10 = DivideListIntoGroups(data=flatten_4, number=subtraction_5)

# ----
rev = ReverseList(List=flip_3)
rev_2 = ReverseList(List=flip_4)
item_3 = ListItem(List=flip_3, Index=number_slider, Wrap=False)
item_4 = ListItem(List=rev, Index=number_slider, Wrap=False)
item_5 = ListItem(List=flip_4, Index=number_slider_2, Wrap=False)
item_6 = ListItem(List=rev_2, Index=number_slider_2, Wrap=False)
flip_5 = FlipMatrix(Data=item_3)
flip_6 = FlipMatrix(Data=item_4)
flip_7 = FlipMatrix(Data=item_5)
flip_8 = FlipMatrix(Data=item_6)
Y_7 = UnitY(Factor=division_5)
crv = Curve(flatten(flip_7))
crv_2 = Curve(flatten(flip_8))
crv_3 = Curve(flatten(flip_5))
crv_4 = Curve(flip_6)
graft_21 = GraftTree(Tree=crv_3, IncludeEmptyLists=True, IncludeNullItems=True)  # -> simplify(Tree)
graft_22 = GraftTree(Tree=crv_4, IncludeEmptyLists=True, IncludeNullItems=True)  # -> simplify(Tree)
graft_23 = GraftTree(Tree=crv_2, IncludeEmptyLists=True, IncludeNullItems=True)  # -> simplify(Tree)
graft_24 = GraftTree(Tree=crv, IncludeEmptyLists=True, IncludeNullItems=True)  # -> simplify(Tree)
merge_5 = Merge(Data1=graft_21, Data2=div_list_10)
merge_6 = Merge(Data1=graft_24, Data2=div_list_5)
merge_7 = Merge(Data1=div_list_10, Data2=graft_22)
merge_8 = Merge(Data1=div_list_5, Data2=graft_23)
flip_9 = FlipMatrix(Data=merge_5)
flip_10 = FlipMatrix(Data=merge_7)
flatten_5 = FlattenTree(Tree=flip_9, Path="{0}")
flatten_6 = FlattenTree(Tree=merge_6, Path="{0}")
flatten_7 = FlattenTree(Tree=flip_10, Path="{0}")
flatten_8 = FlattenTree(Tree=merge_8, Path="{0}")
graft_25 = GraftTree(Tree=flatten_5, IncludeEmptyLists=True, IncludeNullItems=True)
graft_26 = GraftTree(Tree=flatten_6, IncludeEmptyLists=True, IncludeNullItems=True)
graft_27 = GraftTree(Tree=flatten_7, IncludeEmptyLists=True, IncludeNullItems=True)
graft_28 = GraftTree(Tree=flatten_8, IncludeEmptyLists=True, IncludeNullItems=True)
merge_9 = Merge(Data1=graft_25, Data2=graft_26, Data3=graft_27, Data4=graft_28)
gate = StreamGate(Stream=merge_9, Gate=list)  # -> Target0, Target1
flip_11 = FlipMatrix(Data=gate.Target0)
join = JoinCurves(Curves=[gate.Target1, flip_11], Preserve=False)
filter = StreamFilter(Gate=list, Stream0="Curves", Stream1="Jigsaw pieces")
crv_5 = Curve(join)
division_18 = Division(A=size_tiles, B="12")
ext = ExtendCurve(Curve=crv_5, Type=0, Start=division_18, End=division_18)
filter_2 = StreamFilter(Gate=list, Stream0=ext, Stream1=crv_5)
preview = CustomPreview(Geometry=filter_2, Shader=swatch)
bake = ObjectBake(
    BakeToggle=bakebutton,
    GeometryObjects=filter_2,
    Layer=filter,
    ObjectName="GH_Obj",
    ObjectColor=swatch,
    LayerColor=swatch)

# ==== cluster DivideListIntoGroups: Divides data as a list into given number of groups
number = ClusterInput()  # Insert number for amount of groups
data = ClusterInput()  # Insert list as data
flatten = FlattenTree(Data=data, Path="{0}")
lng = ListLength(List=flatten)
division = Division(A=lng, B=number)
round = Round(Number=division)  # -> Nearest, Floor, Ceiling
series = Series(Start=0, Step=1, Count=round.Ceiling)
graft = GraftTree(Data=flatten, IncludeEmptyLists=True, IncludeNullItems=True)
series_2 = Series(Start=0, Step=1, Count=lng)
dup = DuplicateData(Data=series, Number=number, Order=Toggle(False))
simplify = SimplifyTree(Tree=graft, Front=False)
int = Integer(series_2)
eval = Evaluate(F="\"{\"&x&\"}\"", x=int)
eval_2 = Evaluate(F="\"{\"&x&\"}\"", x=dup)
split = SplitList(List=eval_2, Index=lng)  # -> ListA, ListB
replace = ReplaceBranches(Data=simplify, Search=eval, Replace=split.ListA)
D = ClusterOutput(replace)
